# Grasshopper definition FinalInterface2.gh (Grasshopper 1.0.7)
# plug-ins: Pufferfish, LunchBox

# Classification
# Centroids
text = Text(flatten(Tree({0}: ["7"], {1}: ["7"], {2}: ["7"], {3}: ["7"], {4}: ["7"], {5}: ["7"]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)))
# Lat/Long
text_2 = Text(Tree({0}: ["7457.080322", "4829.67749", "14.22304", "40.836387"], {1}: ["7638.810547", "4942.768066", "14.2251799999999", "40.837385"], {2}: ["8002.27002", "4942.768066", "14.22946", "40.837385"], {3}: ["8184.000488", "4829.67749", "14.2316", "40.836387"], {4}: ["8365.730469", "4490.407227", "14.23374", "40.833395"], {5}: ["8365.730469", "4716.587402", "14.23374", "40.83539"]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))
# 400m
# Data Set
text_3 = Text(Tree({0}: ["0.05", "0.25", "0.9", "0.85", "1", "0.95", "0.8"], {1}: ["0.15", "0.2", "1", "0.75", "1", "0.95", "0.8"], {2}: ["0.25", "0.3", "0.95", "0.7", "1", "0.95", "0.8"], {3}: ["0.25", "0.35", "0.95", "0.75", "1", "0.95", "0.8"], {4}: ["0.25", "0.35", "1", "0.95", "1", "0.95", "0.8"], {5}: ["0.3", "0.55", "0.95", "0.85", "1", "0.95", "0.8"]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))
text_4 = Text(Tree({0}: ["0.103979534308446", "0.997055347111975", "-0.263689474490521", "0.397175612588454", "0.603564659172404", "-0.236100070400755", "-0.236003469333995", "0.810226194257525"], {1}: ["-0.358638662900312", "-0.532662645833748", "-0.457640434024429", "0.445676641428643", "0.165987551078199", "-0.236100070400754", "-1.23872154122932", "-0.497109438352286"], {2}: ["-0.0195749286529718", "-0.769457295900993", "1.33610326688929", "0.253961400771237", "0.906525940946536", "4.23549217203786", "-0.708781124783708", "0.0542489285846843"], {3}: ["-0.400246947145057", "-0.106084380789949", "-0.403269829749646", "-1.89053058440802", "-1.16403253700156", "-0.236100070400756", "-0.203031072365776", "-1.23246943145033"], {4}: ["3.38584841903168", "1.73966883320981", "-0.159372662927787", "-0.243921350491449", "0.737485439507347", "-0.236100070400756", "0.914140703123639", "2.55082881135498"], {5}: ["-0.300584827578767", "-0.737070771395761", "-0.135470791541697", "0.459756612710264", "-0.0760615103200766", "-0.236100070400754", "0.707190576915565", "-0.339303942074413"], {6}: ["-0.0879295681969858", "-0.599717965284496", "-0.0152817994681131", "-2.00133528828428", "0.707257552026663", "-0.236100070400755", "-0.469042302960748", "-0.971555157147251"], {7}: ["0.134374357618126", "-0.409642944248347", "2.15606500745569", "0.124626584020576", "0.858290783601323", "-0.236100070400755", "0.536855859681442", "0.578235040032025"], {8}: ["2.3238955760692", "1.57417861996192", "0.17079969049786", "-0.363424235045836", "0.865409766991475", "4.23549217203785", "-0.0977383059477592", "2.02518965694603"], {9}: ["-0.447865693440633", "0.658574458861899", "-0.340521625885735", "0.537286110836878", "-1.30042171203745", "-0.236100070400754", "0.768003498073357", "0.0670380176656166"]))
text_5 = Text(flatten(Tree({0}: ["9"], {1}: ["9"], {2}: ["2"], {3}: ["2"], {4}: ["9"], {5}: ["2"]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)))
# 800m
# Data Set
# Classification
text_6 = Text(Tree({0}: ["0.5", "0.6", "0.9", "0.95", "0.8", "1", "0.85"], {1}: ["0.6", "0.65", "0.95", "0.95", "0.8", "0.95", "0.85"], {2}: ["0.8", "0.7", "1", "0.95", "0.8", "0.9", "0.8"], {3}: ["0.85", "0.65", "1", "0.95", "0.8", "0.85", "0.8"], {4}: ["0.75", "0.5", "0.85", "0.95", "0.85", "0.9", "0.8"], {5}: ["0.9", "0.6", "0.95", "0.95", "0.8", "0.85", "0.8"]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))
# Centroids
text_7 = Text(Tree({0}: ["-0.776366525451621", "-0.996996627608822", "-1.24219705461033", "-0.237042757993216", "0.80152961021354", "-0.398037086437263", "0.883459224743138", "-0.819892052784442"], {1}: ["-0.166057782132203", "0.177519774191224", "0.134808510787606", "-0.237042757993216", "-0.873573850916945", "-0.345897749779022", "-1.39222759338943", "-0.384988921574952"], {2}: ["1.82498979271206", "1.43610064186483", "0.761647681231808", "-0.237042757993216", "0.715688173848214", "0.654672430408749", "-0.988333889117681", "1.59140393856476"], {3}: ["-0.623242362610461", "-0.538726382461105", "0.387224390631017", "-0.237042757993216", "-1.18411680231892", "-0.628972069374956", "0.476218437686582", "-0.535997396419455"], {4}: ["0.283247601611158", "0.179443875375036", "0.589578064987606", "4.21864818172871", "-0.909789945544142", "0.813715282697556", "0.323736548552773", "0.511056819058065"], {5}: ["-0.432583272562306", "-0.152784262363071", "0.393251300339939", "-0.237042757993216", "0.736074093981216", "-0.199756331728639", "0.598665074348201", "-0.161745141795267"], {6}: ["1.47073492187716", "1.46998401402455", "0.687295018597152", "-0.237042757993216", "-0.307614053130797", "-0.320995150960014", "0.54318901093885", "1.46040927915786"], {7}: ["-0.449398381036875", "-0.665274252335196", "-1.12781067535859", "-0.237042757993216", "-0.0402441284254929", "-0.570882715856948", "-1.00539258922745", "-0.893365924712283"], {8}: ["1.77719003295661", "1.46127193968657", "0.91490819111189", "4.21864818172871", "-0.035070660034354", "2.15390376220263", "0.0434127008477671", "1.93555865467306"], {9}: ["0.182937209968705", "0.511884916878823", "0.350201945276232", "-0.237042757993216", "0.58233064879448", "2.12827220897992", "0.107457888983084", "0.719347311776073"]))
# Lat/Long
text_8 = Text(Tree({0}: ["7457.080322", "4829.67749", "14.22304", "40.836387"], {1}: ["7638.810547", "4942.768066", "14.2251799999999", "40.837385"], {2}: ["8002.27002", "4942.768066", "14.22946", "40.837385"], {3}: ["8184.000488", "4829.67749", "14.2316", "40.836387"], {4}: ["8365.730469", "4490.407227", "14.23374", "40.833395"], {5}: ["8365.730469", "4716.587402", "14.23374", "40.83539"]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))
display_amenities = BooleanToggle(True)

# ---- group: RH_IN:Radius
# Radius around the site to be considered
radius = Slider(0, range=0..2)

# ---- group: RH_IN:SelectAmenities
selectamenities = Slider(10, range=1..10)

# ---- group: RH_IN:AnalysisType
analysistype = Slider(0, range=0..6)

# ----
text_9 = Text(flatten(Tree({0}: ["4"], {1}: ["4"], {2}: ["4"], {3}: ["4"], {4}: ["4"], {5}: ["4"]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)))
# 1200m
# Data Set
# Classification
text_10 = Text(Tree({0}: ["1", "0.65", "0.85", "0.95", "0.8", "1", "0.95"], {1}: ["1", "0.7", "0.8", "0.95", "0.8", "1", "0.95"], {2}: ["1", "0.7", "0.8", "0.95", "0.75", "0.95", "0.95"], {3}: ["1", "0.7", "0.8", "0.9", "0.75", "0.95", "0.95"], {4}: ["1", "0.6", "0.85", "0.95", "0.85", "0.95", "0.95"], {5}: ["1", "0.7", "0.85", "0.9", "0.85", "0.95", "0.95"]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))

# ---- group: RH_IN:DisplayAnalysis
boolean = Boolean(True)

# ----
# Centroids
text_11 = Text(Tree({0}: ["-0.747611489137118", "-0.599125496799021", "-1.04186402657394", "-0.529339857382214", "0.511083585465842", "0.407214477850142", "-0.240784442382827", "-0.697782007161674"], {1}: ["1.26625652129867", "1.15065503461481", "-0.366539929764063", "-0.31243777377924", "0.612172015924172", "0.370995989525667", "-0.240784442382824", "1.15480786210031"], {2}: ["-0.533913761329282", "-0.64815520718727", "-0.210076825006853", "-0.598443830773374", "-1.16359712260017", "-1.21725364434609", "-0.240784442382825", "-1.00474348942237"], {3}: ["1.07530928083908", "0.733791045806976", "-0.601717087845349", "1.33511118251045", "0.140702103091025", "0.920134437277472", "4.15309224343521", "1.20031208170605"], {4}: ["0.963938262914133", "0.825347893260399", "0.786892643391551", "2.11772178269613", "-0.0848560668383866", "0.931151446213122", "-0.240784442382824", "1.29310393167578"], {5}: ["-0.288888030829095", "-0.122026554004298", "0.937957418479912", "-0.00275061165710509", "0.612320209778255", "-0.313027823751068", "-0.240784442382824", "-0.0731652383688966"], {6}: ["1.13527859019367", "0.197052992188675", "0.0634607075541534", "-0.603154842288476", "-1.44263765424743", "-0.455326317863261", "-0.240784442382825", "0.348133509944819"], {7}: ["-0.983742808711228", "-1.02559938397711", "0.711031310602936", "-0.445139041236404", "0.691469888606025", "-1.30047324184455", "-0.240784442382826", "-0.962622072611143"], {8}: ["-0.462349033632761", "-0.082905852752716", "-0.914924352956373", "-0.188105777699691", "-1.75902179070193", "0.697086137317433", "-0.240784442382825", "-0.511076006106718"], {9}: ["1.28099793395478", "1.90221781597387", "0.479171957640426", "0.0929531925383735", "-0.805371973010941", "0.88288797974211", "-0.240784442382825", "1.46356469782337"]))
# Lat/Long
text_12 = Text(Tree({0}: ["7457.080322", "4829.67749", "14.22304", "40.836387"], {1}: ["7638.810547", "4942.768066", "14.2251799999999", "40.837385"], {2}: ["8002.27002", "4942.768066", "14.22946", "40.837385"], {3}: ["8184.000488", "4829.67749", "14.2316", "40.836387"], {4}: ["8365.730469", "4490.407227", "14.23374", "40.833395"], {5}: ["8365.730469", "4716.587402", "14.23374", "40.83539"]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))
stream_filter = StreamFilter(Gate=radius, Stream0=text_4, Stream1=text_7, Stream2=text_11)
stream_filter_2 = StreamFilter(Gate=radius, Stream0=text_2, Stream1=text_8, Stream2=text_12)
stream_filter_3 = StreamFilter(Gate=radius, Stream0=text_3, Stream1=text_6, Stream2=text_10)
stream_filter_4 = StreamFilter(Gate=radius, Stream0=text, Stream1=text_5, Stream2=text_9)
series = Series(Start="1", Step=1, Count="2476")
series_2 = Series(Start=0, Step=1, Count="2475")
panel = Panel("""Connectivity
Walkability
Population Density
Building Density
Google Maps
Sentimental
Outdoor Comfort""")

# ---- group: points
point = Point(Point(7973.694766, 7018.702385, 0))

# ----
points = GetPoint(point, AtLeast=1, AtMost=5, Realtime=True)
list_item = ListItem(List=panel, Index=analysistype, Wrap=True)
cull_index = CullIndex(List=stream_filter, Indices="-1", Wrap=True)
tree_branch = TreeBranch(Tree=stream_filter_2, Path=series, MaintainPaths=False)
tree_branch_2 = TreeBranch(Tree=stream_filter_3, Path=series, MaintainPaths=False)
list_item_2 = ListItem(List=stream_filter_4, Index=series_2, Wrap=True)
panel_2 = Panel(cull_index)
absolute = Absolute(Value=cull_index)
# -- Analysis Title
concatenate = Concatenate(Fragment_B="  //     ", A=list_item, C="   ", B="Analysis")
panel_3 = Panel(tree_branch_2)
panel_4 = Panel(list_item_2)
# The Point
number_slider = Slider(1000, range=0..1000)  # disabled
list_item_3 = ListItem(List=tree_branch, Index=0, Wrap=True)  # -> Item, Item1

# ----
# Connectivity
# Walkability
# Population Density
# Building Density
# Google Maps
# Sentimental
# Outdoor Comfort
construct_point = ConstructPoint(XCoordinate=list_item_3.Item, YCoordinate=list_item_3.Item1, ZCoordinate=0)
# Analysis Display
list_item_4 = ListItem(List=tree_branch_2, Index=analysistype, Wrap=True)

unit_z = UnitZ(Factor=number_slider)  # disabled
move = Move(Geometry=points, Motion=unit_z)  # -> Geometry, Transform; disabled
line = Line(StartPoint=points, EndPoint=move.Geometry)  # disabled
curve = Curve([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])
list_length = ListLength(List=curve)
panel_5 = Panel(list_length)
flatten_tree = FlattenTree(Tree=curve, Path="{0}")
area = Area(Geometry=flatten_tree)  # -> Area, Centroid
mass_addition = MassAddition(Input=simplify(absolute))  # -> Result, PartialResults
series_3 = Series(Start=0, Step=1, Count=10)
closest_point = ClosestPoint(Point=points, Cloud=area.Centroid)  # -> ClosestPoint, CPIndex, Distance
surface = Surface(flatten_tree)
# Sort Duplicate Values in native GH
create_set = CreateSet(List=series_3)  # -> Set, Map
list_indices = ListIndices(List=list_item_2)
list_item_5 = ListItem(List=surface, Index=closest_point.CPIndex, Wrap=True)
equality = Equality(FirstNumber=graft(create_set.Set), SecondNumber=list_item_2)  # -> Equality, Inequality
colour_swatch = ColourSwatch(SwatchColor=RGB(60, 0, 255))
sort_duplicate_values = SortDuplicateValues(ValueList=list_item_2)  # -> UniqueValues, Indices
dispatch = Dispatch(List=list_indices, DispatchPattern=simplify(equality.Equality))  # -> ListA, ListB
mesh_colours = MeshColours(Mesh=list_item_5, Colours=colour_swatch)
custom_preview = CustomPreview(Geometry=list_item_5, Material=colour_swatch)  # disabled
panel_6 = Panel(dispatch.ListA)
param_viewer = ParamViewer(mass_addition.Result)
list_item_6 = ListItem(List=curve, Index=dispatch.ListA, Wrap=True)
bounds = Bounds(Numbers=list_item_2)
sort_list = SortList(Keys=flatten(mass_addition.Result), ValuesValuesA=simplify(param_viewer))  # -> Keys, ValuesValuesA
range = Range(Domain=bounds, Steps=expr("x-1", 10))
deconstruct_domain = DeconstructDomain(Domain=bounds)  # -> Start, End
list_length_2 = ListLength(List=param_viewer)
series_4 = Series(Start=0, Step=1, Count=list_length_2)
gradient = Gradient(
    LowerLimit=0,
    UpperLimit=deconstruct_domain.End,
    Parameter=range,
    stops=[0.15: RGB(255, 130, 160), 0.85: RGB(220, 0, 40)])
surface_2 = Surface(list_item_6)
data_path = DataPath(series_4)
replace_paths = ReplacePaths(Data=mass_addition.Result, Search=sort_list.ValuesValuesA, Replace=data_path)
replace_paths_2 = ReplacePaths(Data=surface_2, Search=sort_list.ValuesValuesA, Replace=data_path)
panel_8 = Panel(replace_paths)
panel_9 = Panel(closest_point.CPIndex)
mesh = Mesh(replace_paths_2)
panel_10 = Panel(dispatch.ListA)
member_index = MemberIndex(Set=panel_10, Member=panel_9)  # -> simplify(Index), Count
mesh_colours_2 = MeshColours(Mesh=mesh, Colours=graft(gradient))
clean_tree = CleanTree(RemoveNulls=True, RemoveInvalid=True, RemoveEmpty=invert(False), Tree=member_index.Index)  # -> simplify(Tree)
text_13 = Text(tree_branch_2)
panel_11 = Panel(clean_tree)
tree_statistics = TreeStatistics(Tree=simplify(clean_tree))  # -> Paths, Length, Count
panel_12 = Panel(tree_statistics.Paths)
tree_branch_3 = TreeBranch(Tree=simplify(text_13), Path=closest_point.CPIndex, MaintainPaths=True)
tree_branch_4 = TreeBranch(Tree=simplify(surface_2), Path=panel_12, MaintainPaths=True)
area_2 = Area(Geometry=curve)  # -> Area, Centroid
area_3 = Area(Geometry=tree_branch_4)  # -> Area, Centroid
mass_addition_2 = MassAddition(Input=tree_branch_3)  # -> Result, PartialResults
closest_point_2 = ClosestPoint(Point=area_3.Centroid, Cloud=area_2.Centroid)  # -> ClosestPoint, CPIndex, Distance
tree_branch_5 = TreeBranch(Tree=text_13, Path=closest_point_2.CPIndex, MaintainPaths=False)
mass_addition_3 = MassAddition(Input=tree_branch_5)  # -> flatten(Result), PartialResults
list_item_7 = ListItem(List=curve, Index=closest_point_2.CPIndex, Wrap=True)
panel_13 = Panel(mass_addition_2.Result)

# ----
# Attractivity of Selected Locality
panel_14 = Panel("Attractivity of Selected Locality")
# Analysis data for selected amenity
# (to plot in bar chart)
panel_15 = Panel("   //    ")
concatenate_2 = Concatenate(Fragment_A=panel_14, Fragment_B=panel_15, A=panel_13)

panel_16 = Panel(mass_addition_3.Result)

# ----
# Connectivity
# Walkability
# Population Density
# Building Density
# Google Maps
# Sentimental
# Outdoor Comfort
round_to_decimal_place = RoundToDecimalPlace(NumberX=tree_branch_3, DecimalPlace=2, RoundType=0)  # -> Rounded, Difference

panel_17 = Panel("3")  # disabled
member_index_2 = MemberIndex(Set=panel_16, Member=panel_13)  # -> Index, Count
list_item_8 = ListItem(List=member_index_2.Index, Index=0, Wrap=True)
series_5 = Series(Start=list_item_8, Step=1, Count=panel_17)  # disabled
tree_branch_6 = TreeBranch(Tree=tree_branch_5, Path=series_5, MaintainPaths=False)  # disabled
series_6 = Series(Start=list_item_8, Step=1, Count=selectamenities)
tree_branch_7 = TreeBranch(Tree=tree_branch_6, Path="{0}", MaintainPaths=True)  # disabled
tree_branch_8 = TreeBranch(Tree=tree_branch_6, Path="{1}", MaintainPaths=True)  # disabled
tree_branch_9 = TreeBranch(Tree=tree_branch_6, Path="{2}", MaintainPaths=True)  # disabled
list_item_9 = ListItem(List=panel_16, Index=series_6, Wrap=True)
list_item_10 = ListItem(List=list_item_7, Index=series_6, Wrap=True)

# ---- group: RH_OUT:AnalysisTitle
# Analysis Title
# Attractivity of selected locality
text_14 = Text(concatenate)

# ---- group: RH_OUT:Attractivity
text_15 = Text(panel_13)

# ---- group: RH_OUT:ClassificationMesh
# Classification Mesh
mesh_2 = Mesh(mesh_colours_2)

# ---- group: RH_OUT:SelectedMesh
# Selected Locality Coloured Blue
# Data for Pie Chart
mesh_3 = Mesh(mesh_colours)

# ---- group: RH_OUT:AttractivityData
text_16 = Text(round_to_decimal_place.Rounded)

# ----
subtraction = Subtraction(A=mass_addition_2.Result, B=list_item_9)
area_4 = Area(Geometry=list_item_10)  # -> Area, Centroid
absolute_2 = Absolute(Value=subtraction)
division = Division(A=absolute_2, B=mass_addition_2.Result)
number = Number(expr("x*100", division))
slider = Slider(11, range=0..11)
subtraction_2 = Subtraction(A="100", B=number)
pt = Point(area_4.Centroid)
bool = Boolean(True)
round_to_decimal_place_2 = RoundToDecimalPlace(NumberX=subtraction_2, DecimalPlace=1, RoundType=0)  # -> Rounded, Difference
panel_18 = Panel(round_to_decimal_place_2.Rounded)
c_script = CSharpScript(face="Futura", bold=bool, size=Slider(45, range=0..100), content=panel_18, pl=pt)  # -> out, A; inputs face: String, bold: Boolean, italics: Boolean, size: Double, content: String, pl: Plane
# ---------- c_script: C# ----------
    if(size == 0)
      size = 1;

    if(!string.IsNullOrEmpty(face) && size > 0 && !string.IsNullOrEmpty(content) &&
      pl.IsValid)
    {

      var te = RhinoDoc.ActiveDoc.Objects.AddText(content, pl, size, face, bold, italics);
      Rhino.DocObjects.TextObject txt = RhinoDoc.ActiveDoc.Objects.Find(te) as Rhino.DocObjects.TextObject;

      if(txt != null)
      {
        var tt = txt.Geometry as Rhino.Geometry.TextEntity;
        A = tt.Explode();
      }
      
      RhinoDoc.ActiveDoc.Objects.Delete(te, true);
    }
# ---------- end c_script ----------
move_2 = Move(Geometry=c_script.A, Motion=Vector(0, 0, 10))  # -> Geometry, Transform
mesh_4 = Mesh(move_2.Geometry)
mesh_colours_3 = MeshColours(Mesh=mesh_4, Colours=ColourSwatch(SwatchColor=RGB(255, 255, 255)))

# ---- group: RH_OUT:TextMesh
# Percentage similatity text
mesh_5 = Mesh(mesh_colours_3)

# ----
panel_19 = Panel("46")  # disabled
panel_20 = Panel("8")  # disabled
series_7 = Series(Start=panel_19, Step=1, Count=panel_20)  # disabled

# ---- group: 1200
panel_21 = Panel("3")  # disabled
panel_22 = Panel("31")  # disabled
panel_23 = Panel("3")  # disabled
series_8 = Series(Start=panel_22, Step=panel_21, Count=panel_23)  # disabled

# ---- group: 800
panel_24 = Panel("3")  # disabled
panel_25 = Panel("30")  # disabled
panel_26 = Panel("3")  # disabled
series_9 = Series(Start=panel_25, Step=panel_24, Count=panel_26)  # disabled

# ---- group: 400
panel_27 = Panel("3")  # disabled
panel_28 = Panel("29")  # disabled
panel_29 = Panel("3")  # disabled
series_10 = Series(Start=panel_28, Step=panel_27, Count=panel_29)  # disabled

# ----
panel_30 = Panel("38")  # disabled
panel_31 = Panel("8")  # disabled
series_11 = Series(Start=panel_30, Step=1, Count=panel_31)  # disabled

panel_32 = Panel("""400
800
1200""")
list_item_11 = ListItem(List=panel_32, Index=radius, Wrap=True)
point_2 = Point(points)
surface_3 = Surface(Tree({0;0}: [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], {0;1}: [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], {0;2}: [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], {0;3}: [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], {0;4}: [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], {0;5}: [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], {0;6}: [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], {0;7}: [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]))
circle = Circle(Plane=point_2, Radius=list_item_11)
area_5 = Area(Geometry=surface_3)  # -> Area, Centroid
point_in_curve = PointInCurve(Point=area_5.Centroid, Curve=circle)  # -> Relationship, Point
dispatch_2 = Dispatch(List=area_5.Centroid, DispatchPattern=point_in_curve.Relationship)  # -> ListA, ListB
point_3 = Point(dispatch_2.ListA)
line_2 = Line(StartPoint=point_2, EndPoint=point_3)  # -> simplify(Line)
clean_tree_2 = CleanTree(RemoveNulls=True, RemoveInvalid=True, RemoveEmpty=invert(False), Tree=line_2)
list_length_3 = ListLength(List=simplify(line_2))
length = Length(Curve=line_2)
panel_33 = Panel(list_length_3)
clean_tree_3 = CleanTree(RemoveNulls=True, RemoveInvalid=True, RemoveEmpty=invert(False), Tree=length)  # -> simplify(Tree)
panel_34 = Panel(clean_tree_3)
bounds_2 = Bounds(Numbers=clean_tree_3)
deconstruct_domain_2 = DeconstructDomain(Domain=bounds_2)  # -> Start, End
panel_35 = Panel(deconstruct_domain_2.Start)
member_index_3 = MemberIndex(Set=clean_tree_3, Member=deconstruct_domain_2.Start)  # -> simplify(Index), Count
list_item_12 = ListItem(List=simplify(clean_tree_2), Index=member_index_3.Index, Wrap=True)  # -> simplify(Item)
trim_tree = TrimTree(Tree=member_index_3.Index, Depth=1)
end_points = EndPoints(Curve=list_item_12)  # -> Start, End
panel_36 = Panel(trim_tree)
tree_statistics_2 = TreeStatistics(Tree=trim_tree)  # -> simplify(Paths), Length, Count
filtered_amenity_s_branches = Panel(tree_statistics_2.Paths)
panel_37 = Panel("""retail
food
education
entertainment
religion
commercial
healthcare
public""")
ghpython_script = GhPythonScript(x=filtered_amenity_s_branches)  # -> flatten(out), a
# ---------- ghpython_script: Python ----------
print(x.translate({ord(i): None for i in '{}'}))
# ---------- end ghpython_script ----------
concatenate_3 = Concatenate(Fragment_A=graft(panel_37), Fragment_B=" //", A=list_length_3)
list_item_13 = ListItem(List=panel_37, Index=ghpython_script.out, Wrap=True)
cull_index_2 = CullIndex(List=panel_37, Indices=ghpython_script.out, Wrap=True)

panel_38 = Panel(list_item_13)
panel_39 = Panel(cull_index_2)

concatenate_4 = Concatenate(FragmentA="//   ", FragmentB=panel_39)
concatenate_5 = Concatenate(FragmentA="//   ", FragmentB=panel_38)
merge = Merge(Data1="Amenities Available", Data2=concatenate_5, Data4="Amenities Unavailable", Data5=concatenate_4)  # -> flatten(Result)

text_17 = Text(flatten(concatenate_3))  # disabled

text_18 = Text(merge)  # disabled

# ---- group: RH_OUT:PieChartData
# Amenities Available / Unavailable
number_2 = Number(flatten(list_length_3))

# ---- group: RH_OUT:AmenitiesAvailable
text_19 = Text(concatenate_5)

# ---- group: RH_OUT:AmenitiesUnavailable
text_20 = Text(concatenate_4)

# ----
# Amenity Rate < 1200
# Amenity Distance < 1200
# 0 POP density
# 1 BLD density
# 2 Walkability
text_21 = Text(Tree({1}: ["conscore400", "conscore800", "conscore1200", "walkscore400", "walkscore800", "walkscore1200", "popscore400", "popscore800", "popscore1200", "bldscore400", "bldscore800", "bldscore1200", "ratescore400", "ratescore800", "ratescore1200", "senscore400", "senscore800", "senscore1200", "comfscore400", "comfscore800", "comfscore1200", "sum400", "sum800", "sum1200", "long", "lat", "y", "x", "popD400", "popD800", "popD1200", "bldD400", "bldD800", "bldD1200", "walkD400", "walkD800", "walkD1200", "shopping_osm", "food_osm", "education_osm", "entertainment_osm", "religion_osm", "office_osm", "medical_osm", "public_osm", "shopping_google", "food_google", "education_google", "entertainment_google", "religion_google", "office_google", "medical_google", "public_google", "number"], {2}: ["0.05", "0.5", "1", "0.25", "0.6", "0.65", "0.9", "0.9", "0.85", "0.85", "0.95", "0.95", "1", "0.8", "0.8", "0.95", "1", "1", "0.8", "0.85", "0.95", "0.7", "0.8", "0.9", "40.836387", "14.22304", "4829.67749", "7457.080322", "6454", "26319", "56535", "0.35", "0.25", "0.25", "108", "109", "106", "0", "590", "1020", "0", "220", "460", "390", "550", "4.2", "4.1", "4", "3.5", "4.3", "3.5", "4.5", "4.4", "0"], {3}: ["0.15", "0.6", "1", "0.2", "0.65", "0.7", "1", "0.95", "0.8", "0.75", "0.95", "0.95", "1", "0.8", "0.8", "0.95", "0.95", "1", "0.8", "0.85", "0.95", "0.7", "0.8", "0.9", "40.837385", "14.22518", "4942.768066", "7638.810547", "7521", "29373", "62287", "0.3", "0.25", "0.25", "93", "103", "105", "1090", "380", "1190", "0", "200", "560", "190", "620", "4.2", "4.1", "4", "3.5", "4.3", "3.5", "4.5", "4.4", "1"], {4}: ["0.25", "0.8", "1", "0.3", "0.7", "0.7", "0.95", "1", "0.8", "0.7", "0.95", "0.95", "1", "0.8", "0.75", "0.95", "0.9", "0.95", "0.8", "0.8", "0.95", "0.7", "0.85", "0.85", "40.837385", "14.22946", "4942.768066", "8002.27002", "8184", "30722", "65456", "0.25", "0.25", "0.3", "86", "97", "98", "870", "330", "1130", "1160", "140", "700", "170", "700", "4.2", "4.1", "4", "3.5", "4.3", "3.5", "4.5", "4.4", "2"], {5}: ["0.25", "0.85", "1", "0.35", "0.65", "0.7", "0.95", "1", "0.8", "0.75", "0.95", "0.9", "1", "0.8", "0.75", "0.95", "0.85", "0.95", "0.8", "0.8", "0.95", "0.75", "0.85", "0.85", "40.836387", "14.2316", "4829.67749", "8184.000488", "7891", "28455", "61919", "0.25", "0.25", "0.3", "92", "104", "95", "910", "320", "990", "970", "80", "750", "370", "720", "4.2", "4.1", "4", "3.5", "4.3", "3.5", "4.5", "4.4", "3"], {6}: ["0.25", "0.75", "1", "0.35", "0.5", "0.6", "1", "0.85", "0.85", "0.95", "0.95", "0.95", "1", "0.85", "0.85", "0.95", "0.9", "0.95", "0.8", "0.8", "0.95", "0.75", "0.85", "0.85", "40.833395", "14.23374", "4490.407227", "8365.730469", "5753", "19531", "48228", "0.15", "0.25", "0.3", "133", "100", "98", "0", "40", "940", "880", "260", "790", "690", "710", "4.2", "4.1", "4", "3.5", "4.3", "3.5", "4.5", "4.4", "4"]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))  # disabled
panel_40 = Panel(text_21)  # disabled
panel_41 = Panel("1")  # disabled
text_22 = Text(Tree({1}: ["conscore400", "0.05", "0.15", "0.25", "0.25", "0.25"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], {2}: ["conscore800", "0.5", "0.6", "0.8", "0.85", "0.75"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], {3}: ["conscore1200", "1", "1", "1", "1", "1"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], {4}: ["walkscore400", "0.25", "0.2", "0.3", "0.35", "0.35"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], {5}: ["walkscore800", "0.6", "0.65", "0.7", "0.65", "0.5"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], {6}: ["walkscore1200", "0.65", "0.7", "0.7", "0.7", "0.6"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]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))  # disabled
panel_42 = Panel("0")  # disabled
cull_i = CullIndex(List=text_22, Indices=panel_42, Wrap=True)  # -> simplify(List); disabled
panel_43 = Panel("""27
28""")  # disabled
branch = TreeBranch(Tree=cull_i, Path=panel_43, MaintainPaths=True)  # disabled
branch_2 = TreeBranch(Tree=cull_i, Path=series_7, MaintainPaths=True)  # disabled
branch_3 = TreeBranch(Tree=cull_i, Path=series_11, MaintainPaths=True)  # disabled
branch_4 = TreeBranch(Tree=cull_i, Path=series_10, MaintainPaths=True)  # disabled
branch_5 = TreeBranch(Tree=cull_i, Path=series_9, MaintainPaths=True)  # disabled
branch_6 = TreeBranch(Tree=cull_i, Path=series_8, MaintainPaths=True)  # disabled
flip = FlipMatrix(Data=branch)  # disabled
item = ListItem(List=flip, Index=0, Wrap=True)  # -> simplify(Item), Item1; disabled
pt_2 = ConstructPoint(XCoordinate=item.Item1, YCoordinate=item.Item, ZCoordinate=0)  # -> flatten(Point); disabled
panel_44 = Panel(item.Item)  # disabled
panel_45 = Panel("""Population Density = 
Building Density = 
Walkability = """)  # disabled
panel_46 = Panel(" = ")  # disabled
panel_47 = Panel(" = ")  # disabled

# ---- group: column features
branch_7 = TreeBranch(Tree=text_21, Path=panel_41, MaintainPaths=True)  # disabled

# ---- group: amenity rate around this location
flip_2 = FlipMatrix(Data=branch_2)  # disabled

# ---- group: closest amenity distance
flip_3 = FlipMatrix(Data=branch_3)  # disabled

# ---- group: 400
flip_4 = FlipMatrix(Data=branch_4)  # disabled

# ---- group: 800
flip_5 = FlipMatrix(Data=branch_5)  # disabled

# ---- group: 1200
flip_6 = FlipMatrix(Data=branch_6)  # disabled

# ----
panel_48 = Panel(branch_7)  # disabled
item_2 = ListItem(List=branch_7, Index=expr("x-1", series_7), Wrap=True)  # disabled
item_3 = ListItem(List=branch_7, Index=expr("x-1", series_11), Wrap=True)  # disabled
panel_49 = Panel(item_2)  # disabled
panel_50 = Panel(item_3)  # disabled
concat = Concatenate(FragmentA=panel_49, FragmentC=panel_46, FragmentB=flip_2)  # disabled
concat_2 = Concatenate(FragmentA=panel_50, FragmentC=panel_47, FragmentB=flip_3)  # disabled
concat_3 = Concatenate(FragmentA=panel_45, FragmentB=flip_4)  # disabled
concat_4 = Concatenate(FragmentA=panel_45, FragmentB=flip_5)  # disabled
concat_5 = Concatenate(FragmentA=panel_45, FragmentB=flip_6)  # disabled
panel_51 = Panel(concat)  # disabled
panel_52 = Panel(concat_3)  # disabled
panel_53 = Panel(concat_4)  # disabled
panel_54 = Panel(concat_5)  # disabled
panel_55 = Panel(concat_2)  # disabled
